# Grasshopper definition honeybee_radiance.gh (Grasshopper 1.0.7)
# plug-ins: Human, Heteroptera, Bifocals

# ----
# Material
# Material Modifier
# concrete
# wood
# aluminium
# brick
# glass
file_path = FilePath("C:\Users\colin\OneDrive\Desktop\Thesis Part 2\thesis - simulation\data\material\material_library.csv")
read_file = ReadFile(File=file_path, PerLineParse=True)
panel = Panel(read_file)
list_item = ListItem(List=panel, Index="1", Wrap=True)
list_item_2 = ListItem(List=panel, Index="2", Wrap=True)
list_item_3 = ListItem(List=panel, Index="3", Wrap=True)
list_item_4 = ListItem(List=panel, Index="4", Wrap=True)
list_item_5 = ListItem(List=panel, Index="5", Wrap=True)
panel_2 = Panel(list_item)
panel_3 = Panel(list_item_2)
panel_4 = Panel(list_item_3)
panel_5 = Panel(list_item_4)
panel_6 = Panel(list_item_5)
text_split = TextSplit(Text=panel_2, Separators=",")
text_split_2 = TextSplit(Text=panel_3, Separators=",")
text_split_3 = TextSplit(Text=panel_4, Separators=",")
text_split_4 = TextSplit(Text=panel_5, Separators=",")
text_split_5 = TextSplit(Text=panel_6, Separators=",")
panel_7 = Panel(text_split)
panel_8 = Panel(text_split_2)
panel_9 = Panel(text_split_3)
panel_10 = Panel(text_split_4)
panel_11 = Panel(text_split_5)
cluster = Cluster(material_list=panel_7)  # -> material_name, r_ref, g_ref, b_ref, spec, rough
cluster_2 = Cluster(material_list=panel_8)  # -> material_name, r_ref, g_ref, b_ref, spec, rough
cluster_3 = Cluster(material_list=panel_10)  # -> material_name, r_ref, g_ref, b_ref, spec, rough
cluster_4 = Cluster(material_list=panel_11)  # -> material_name, r_ref, g_ref, b_ref, spec, rough
cluster_5 = Cluster(material_list=panel_9)  # -> material_name, r_ref, g_ref, b_ref, spec, rough
opaquemod3 = HBOpaqueModifier3(
    name=cluster.material_name,
    r_ref=cluster.r_ref,
    g_ref=cluster.g_ref,
    b_ref=cluster.b_ref,
    spec=cluster.spec,
    rough=cluster.rough)  # -> modifier; plug-in component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
metalmod3 = HBMetalModifier3(
    name=cluster_5.material_name,
    r_ref=cluster_5.r_ref,
    g_ref=cluster_5.g_ref,
    b_ref=cluster_5.b_ref,
    spec=cluster_5.spec,
    rough=cluster_5.rough)  # -> modifier; plug-in component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
opaquemod3_2 = HBOpaqueModifier3(
    name=cluster_2.material_name,
    r_ref=cluster_2.r_ref,
    g_ref=cluster_2.g_ref,
    b_ref=cluster_2.b_ref,
    spec=cluster_2.spec,
    rough=cluster_2.rough)  # -> modifier; plug-in component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
opaquemod3_3 = HBOpaqueModifier3(
    name=cluster_3.material_name,
    r_ref=cluster_3.r_ref,
    g_ref=cluster_3.g_ref,
    b_ref=cluster_3.b_ref,
    spec=cluster_3.spec,
    rough=cluster_3.rough)  # -> modifier; plug-in component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
glassmod3 = HBGlassModifier3(name=cluster_4.material_name, r_trans=cluster_4.r_ref, g_trans=cluster_4.g_ref, b_trans=cluster_4.b_ref)  # -> modifier; plug-in component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

translation = ValueList({"0", "10"}, selected="0")
surrounding_building_material = ValueList({"concrete": 0, "wood": 1, "glass": 2}, selected="concrete")
rotation = ValueList({"0", "10"}, selected="0")
target_building_material = ValueList({"concrete": 0, "wood": 1, "glass": 2}, selected="concrete")
height = ValueList({"0.5", "1"}, selected="1")

# ----
# [Parameter Setup]
# Surrounding Buildings
# [MOVE TO ZERO COORD]
brep = Brep([<brep referenced from the Rhino model> x18])

# ----
# Facade for Analysis
# 2d lines
grid_size = Panel("5")
surface = Surface([<surface referenced from the Rhino model> x18])

# ----
# [Parameter Setup]
# Target Building
# Target Building
brep_2 = Brep(<brep referenced from the Rhino model>)
graft_tree = GraftTree(Tree=brep, IncludeEmptyLists=True, IncludeNullItems=True)
curve = Curve([<curve referenced from the Rhino model> x493])
# 20 csvs in total
stream_gate = StreamGate(Stream=brep_2, Gate=target_building_material)  # -> Target0, Target1, Target2
scale_nu = ScaleNU(Geometry=graft_tree, Plane=PlaneXY(0, 0, 0), ScaleX=1, ScaleY=1, ScaleZ=height)  # -> Geometry, Transform
area = Area(Geometry=scale_nu.Geometry)  # -> Area, Centroid
rotate_3d = Rotate3D(Geometry=scale_nu.Geometry, Angle=rotation, Center=area.Centroid, Axis=Vector(0, 0, 1))  # -> Geometry, Transform
construct_point = ConstructPoint(XCoordinate=translation, YCoordinate=translation, ZCoordinate=translation)
move = Move(Geometry=rotate_3d.Geometry, Motion=construct_point)  # -> Geometry, Transform

# ----
# Surrounding Building
brep_3 = Brep(move.Geometry)

stream_gate_2 = StreamGate(Stream=brep_3, Gate=surrounding_building_material)  # -> Target0, Target1, Target2

# ----
# Surrounding Building Concrete
# Concrete
# Target Building Concrete
brep_4 = Brep(stream_gate_2.Target0)
geometry = Geometry(stream_gate.Target0)
# Surrounding Buildings
mesh_brep = MeshBrep(
    Brep=brep_4,
    Settings={GridMaxCount=0, GridMinCount=16, JaggedSeams=False, MaxEdgeLength=0, MinEdgeLength=0.0001, MinTolerance=0, Refine=True, RefineAngle=0, RelativeTolerance=0.65, SimplePlanes=True, Tolerance=0})
mesh_join = MeshJoin(Meshes=mesh_brep)
merge = Merge(Data1=mesh_join, Data2=geometry)
# Assign Material
shade = HBShade(geo=merge, rad_mod=opaquemod3)  # -> report, shades; plug-in component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

# ----
# Surrounding Building Wood
# Wood
# Target Building Wood
brep_5 = Brep(stream_gate_2.Target1)
geometry_2 = Geometry(stream_gate.Target1)
mesh_brep_2 = MeshBrep(
    Brep=brep_5,
    Settings={GridMaxCount=0, GridMinCount=16, JaggedSeams=False, MaxEdgeLength=0, MinEdgeLength=0.0001, MinTolerance=0, Refine=True, RefineAngle=0, RelativeTolerance=0.65, SimplePlanes=True, Tolerance=0})
mesh_join_2 = MeshJoin(Meshes=mesh_brep_2)
merge_2 = Merge(Data1=mesh_join_2, Data2=geometry_2)
shade_2 = HBShade(geo=merge_2, rad_mod=opaquemod3_2)  # -> report, shades; plug-in component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

# ----
# Surrounding Building Aluminium
# Aluminium
# Target Building Aluminium
brep_6 = Brep([<brep referenced from the Rhino model> x4])
geometry_3 = Geometry(<brep referenced from the Rhino model>)
mesh_brep_3 = MeshBrep(
    Brep=brep_6,
    Settings={GridMaxCount=0, GridMinCount=16, JaggedSeams=False, MaxEdgeLength=0, MinEdgeLength=0.0001, MinTolerance=0, Refine=True, RefineAngle=0, RelativeTolerance=0.65, SimplePlanes=True, Tolerance=0})
mesh_join_3 = MeshJoin(Meshes=mesh_brep_3)
merge_3 = Merge()
shade_3 = HBShade(geo=merge_3, rad_mod=metalmod3)  # -> report, shades; plug-in component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

# ----
# Surrounding Building Brick
# Brick
# Target Building Brick
brep_7 = Brep([<brep referenced from the Rhino model> x4])
geometry_4 = Geometry(<brep referenced from the Rhino model>)
mesh_brep_4 = MeshBrep(
    Brep=brep_7,
    Settings={GridMaxCount=0, GridMinCount=16, JaggedSeams=False, MaxEdgeLength=0, MinEdgeLength=0.0001, MinTolerance=0, Refine=True, RefineAngle=0, RelativeTolerance=0.65, SimplePlanes=True, Tolerance=0})
mesh_join_4 = MeshJoin(Meshes=mesh_brep_4)
merge_4 = Merge()
shade_4 = HBShade(geo=merge_4, rad_mod=opaquemod3_3)  # -> report, shades; plug-in component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

# ----
# Weather EPW Settings
file_path_2 = FilePath("C:\Users\colin\OneDrive\Desktop\Thesis Part 2\thesis - simulation\SGP_SG_Paya.Lebar.AB.486940_TMYx.epw")
wea = HBWeaFromEPW(epw_file=file_path_2)  # -> wea; plug-in component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

# ----
# Facade Sensor Grid
panel_12 = Panel("0.1")
genpts = LBGeneratePointGrid(geometry=surface, grid_size=grid_size, offset_dist=panel_12)  # -> simplify(points), simplify(vectors), face_areas, simplify(mesh); plug-in component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
sensorgrid = HBSensorGrid(positions=genpts.points, directions=genpts.vectors, mesh=genpts.mesh)  # -> grid; plug-in component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

mesh_join_5 = MeshJoin(Meshes=flatten(genpts.mesh))

# ----
# sensor points
point = Point(genpts.points)

# ----
# Wood
merge_5 = Merge(Data1=geometry_2, Data2=brep_5)

# ----
# Aluminium
merge_6 = Merge(Data1=geometry_3, Data2=brep_6)

# ----
# Brep
# Concrete
merge_7 = Merge(Data1=geometry, Data2=brep_4)

# ----
# Brick
merge_8 = Merge(Data1=geometry_4, Data2=brep_7)

# ----
# Visualisation - Graph Network
# Surrounding Building
brep_8 = Brep(brep)
# Target Building
brep_9 = Brep(brep_2)

# ----
# Visulisation - Evaluation Heatmap
file_path_3 = FilePath("C:\Users\colin\OneDrive\Desktop\Thesis Part 2\thesis - simulation\data\labels.csv")
file_path_4 = FilePath("C:\Users\colin\OneDrive\Desktop\Thesis Part 2\thesis - simulation\sensor_predictions.csv")
read_file_2 = ReadFile(File=file_path_3, PerLineParse=True)
read_file_3 = ReadFile(File=file_path_4, PerLineParse=True)
panel_13 = Panel(read_file_3)
panel_14 = Panel(read_file_2)
subtraction = Subtraction(A=read_file_2, B=read_file_3)
division = Division(A=subtraction, B=read_file_2)
multiplication = Multiplication(A=division, B="100")
min_max = MinMax(Number=multiplication)  # -> Minimum, Maximum
panel_15 = Panel(multiplication)
series = Series(Start=0, Step=1, Count="100")
gradient = Gradient(
    LowerLimit=0,
    UpperLimit=100,
    Parameter=series,
    stops=[0: RGB(0, 0, 255), 0.25: RGB(50, 205, 50), 0.5: RGB(255, 225, 0), 0.75: RGB(255, 128, 0), 1: RGB(255, 0, 0)])
gradient_2 = Gradient(
    LowerLimit=min_max.Minimum,
    UpperLimit=min_max.Maximum,
    Parameter=series,
    stops=[0: RGB(234, 38, 0), 0.25: RGB(234, 126, 0), 0.5: RGB(254, 244, 84), 0.75: RGB(173, 203, 249), 1: RGB(75, 107, 169)])
legendpar = LBLegendParameters(min="0", max=min_max.Maximum, seg_count=Slider(10, range=0..10), colors=gradient_2)  # -> leg_par; plug-in component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
heatmap = LBSpatialHeatmap(values=flatten(panel_15), mesh=mesh_join_5, legend_par=legendpar)  # -> mesh, legend, title, colors, legend_par, vis_set; plug-in component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

# ----
# Saved Meshes
mesh = Mesh(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)

# ----
# sensor_length.csv
list_length = ListLength(List=point)
flatten_tree = FlattenTree(Tree=list_length, Path="{0}")
mass_addition = MassAddition(Input=flatten_tree)  # -> Result, PartialResults

# ----
# sensor.csv
# - x, y , z coordinates
deconstruct = Deconstruct(Point=point)  # -> XComponent, YComponent, ZComponent
sensor_x_coordinate = Panel(deconstruct.XComponent)
sensor_z_coordinate = Panel(deconstruct.ZComponent)
sensor_y_coordinate = Panel(deconstruct.YComponent)
graft_tree_2 = GraftTree(Tree=deconstruct.XComponent, IncludeEmptyLists=True, IncludeNullItems=True)
graft_tree_3 = GraftTree(Tree=deconstruct.YComponent, IncludeEmptyLists=True, IncludeNullItems=True)
graft_tree_4 = GraftTree(Tree=deconstruct.ZComponent, IncludeEmptyLists=True, IncludeNullItems=True)
merge_9 = Merge(Data1=graft_tree_2, Data2=graft_tree_3, Data3=graft_tree_4)
delimiter = Panel(", ")
text_join = TextJoin(Text=merge_9, Join=delimiter)  # -> flatten(Result)

# ----
# building_wood_vertex.csv
deconstruct_brep = DeconstructBrep(Brep=merge_5)  # -> Faces, Edges, Vertices
deconstruct_2 = Deconstruct(Point=deconstruct_brep.Vertices)  # -> XComponent, YComponent, ZComponent
x_coordinate = Panel(deconstruct_2.XComponent)
z_coordinate = Panel(deconstruct_2.ZComponent)
y_coordinate = Panel(deconstruct_2.YComponent)
graft_tree_5 = GraftTree(Tree=z_coordinate, IncludeEmptyLists=True, IncludeNullItems=True)
graft_tree_6 = GraftTree(Tree=deconstruct_2.XComponent, IncludeEmptyLists=True, IncludeNullItems=True)
graft_tree_7 = GraftTree(Tree=deconstruct_2.YComponent, IncludeEmptyLists=True, IncludeNullItems=True)
merge_10 = Merge(Data1=graft_tree_6, Data2=graft_tree_7, Data3=graft_tree_5)
delimiter_2 = Panel(", ")
text_join_2 = TextJoin(Text=merge_10, Join=delimiter_2)  # -> flatten(Result)

# ----
# building_alum_vertex.csv
deconstruct_brep_2 = DeconstructBrep(Brep=merge_6)  # -> Faces, Edges, Vertices
deconstruct_3 = Deconstruct(Point=deconstruct_brep_2.Vertices)  # -> XComponent, YComponent, ZComponent
x_coordinate_2 = Panel(deconstruct_3.XComponent)
z_coordinate_2 = Panel(deconstruct_3.ZComponent)
y_coordinate_2 = Panel(deconstruct_3.YComponent)
graft_tree_8 = GraftTree(Tree=z_coordinate_2, IncludeEmptyLists=True, IncludeNullItems=True)
graft_tree_9 = GraftTree(Tree=deconstruct_3.XComponent, IncludeEmptyLists=True, IncludeNullItems=True)
graft_tree_10 = GraftTree(Tree=deconstruct_3.YComponent, IncludeEmptyLists=True, IncludeNullItems=True)
merge_11 = Merge(Data1=graft_tree_9, Data2=graft_tree_10, Data3=graft_tree_8)
delimiter_3 = Panel(", ")
text_join_3 = TextJoin(Text=merge_11, Join=delimiter_3)  # -> flatten(Result)

# ----
# building_brick_vertex.csv
deconstruct_brep_3 = DeconstructBrep(Brep=merge_8)  # -> Faces, Edges, Vertices
deconstruct_4 = Deconstruct(Point=deconstruct_brep_3.Vertices)  # -> XComponent, YComponent, ZComponent
x_coordinate_3 = Panel(deconstruct_4.XComponent)
z_coordinate_3 = Panel(deconstruct_4.ZComponent)
y_coordinate_3 = Panel(deconstruct_4.YComponent)
graft_tree_11 = GraftTree(Tree=z_coordinate_3, IncludeEmptyLists=True, IncludeNullItems=True)
graft_tree_12 = GraftTree(Tree=deconstruct_4.XComponent, IncludeEmptyLists=True, IncludeNullItems=True)
graft_tree_13 = GraftTree(Tree=deconstruct_4.YComponent, IncludeEmptyLists=True, IncludeNullItems=True)
merge_12 = Merge(Data1=graft_tree_12, Data2=graft_tree_13, Data3=graft_tree_11)
delimiter_4 = Panel(", ")
text_join_4 = TextJoin(Text=merge_12, Join=delimiter_4)  # -> flatten(Result)

# ----
# building.csv
# building_conc_vertex.csv
deconstruct_brep_4 = DeconstructBrep(Brep=merge_7)  # -> Faces, Edges, Vertices
deconstruct_5 = Deconstruct(Point=deconstruct_brep_4.Vertices)  # -> XComponent, YComponent, ZComponent
x_coordinate_4 = Panel(deconstruct_5.XComponent)
z_coordinate_4 = Panel(deconstruct_5.ZComponent)
y_coordinate_4 = Panel(deconstruct_5.YComponent)
graft_tree_14 = GraftTree(Tree=z_coordinate_4, IncludeEmptyLists=True, IncludeNullItems=True)
graft_tree_15 = GraftTree(Tree=deconstruct_5.XComponent, IncludeEmptyLists=True, IncludeNullItems=True)
graft_tree_16 = GraftTree(Tree=deconstruct_5.YComponent, IncludeEmptyLists=True, IncludeNullItems=True)
merge_13 = Merge(Data1=graft_tree_15, Data2=graft_tree_16, Data3=graft_tree_14)
delimiter_5 = Panel(", ")
text_join_5 = TextJoin(Text=merge_13, Join=delimiter_5)  # -> flatten(Result)

point_2 = Point(genpts.points)
deconstruct_brep_5 = DeconstructBrep(Brep=brep_8)  # -> Faces, Edges, Vertices
deconstruct_brep_6 = DeconstructBrep(Brep=brep_9)  # -> Faces, Edges, Vertices
brep_wireframe = BrepWireframe(Brep=brep_8, Density=-1)
brep_wireframe_2 = BrepWireframe(Brep=brep_9, Density=-1)
graft_tree_17 = GraftTree(Tree=point_2, IncludeEmptyLists=True, IncludeNullItems=True)
point_3 = Point(graft(deconstruct_brep_5.Vertices))
line = Line(StartPoint=graft_tree_17, EndPoint=point_3)
pipe = Pipe(Curve=line, Radius="0.1", Caps=0)
sensor_length_csv = Panel(mass_addition.Result)
face_boundaries = FaceBoundaries(Mesh=genpts.mesh)
custom_preview_lineweights = CustomPreviewLineweights(Geometry=brep_wireframe, Shader=ColourSwatch(SwatchColor=RGB(171, 171, 171)), Absolute=False)
sensor_csv = Panel(text_join)
custom_preview_lineweights_2 = CustomPreviewLineweights(Geometry=curve, Shader=ColourSwatch(SwatchColor=RGB(153, 153, 153)), Absolute=False)
custom_preview_materials = CustomPreviewMaterials(Geometry=pipe, DiffuseColor=ColourSwatch(SwatchColor=RGB(255, 255, 255)), Transparency="0.75")
dot_display = DotDisplay(Point=deconstruct_brep_5.Vertices, Colour=ColourSwatch(SwatchColor=RGB(255, 255, 255)), Size="0.5")
dot_display_2 = DotDisplay(Point=point_2, Colour=ColourSwatch(SwatchColor=RGB(232, 0, 0)), Size="0.5")
custom_preview_lineweights_3 = CustomPreviewLineweights(Geometry=brep_wireframe_2, Shader=ColourSwatch(SwatchColor=RGB(184, 184, 184)), Absolute=False)
custom_preview_lineweights_4 = CustomPreviewLineweights(Geometry=face_boundaries, Shader=ColourSwatch(SwatchColor=RGB(255, 255, 255)), Absolute=False)
building_wood_vertex_csv = Panel(text_join_2)
building_brick_vertex_csv = Panel(text_join_4)
building_conc_vertex_csv = Panel(text_join_5)
building_alum_vertex_csv = Panel(text_join_3)

# ----
# vertex_length.csv
# vertex_length_conc.csv
point_4 = Point(deconstruct_brep_4.Vertices)
flatten_tree_2 = FlattenTree(Tree=point_4, Path="{0}")
list_length_2 = ListLength(List=flatten_tree_2)

# ----
# vertex_length_brick.csv
point_5 = Point(deconstruct_brep_3.Vertices)
flatten_tree_3 = FlattenTree(Tree=point_5, Path="{0}")
list_length_3 = ListLength(List=flatten_tree_3)

# ----
# vertex_length_wood.csv
point_6 = Point(deconstruct_brep.Vertices)
flatten_tree_4 = FlattenTree(Tree=point_6, Path="{0}")
list_length_4 = ListLength(List=flatten_tree_4)

# ----
# vertex_length_alum.csv
point_7 = Point(deconstruct_brep_2.Vertices)
flatten_tree_5 = FlattenTree(Tree=point_7, Path="{0}")
list_length_5 = ListLength(List=flatten_tree_5)

ghpython_script = GhPythonScript(x=list_length_2)  # -> out, a
# ---------- ghpython_script: Python ----------
__author__ = "colin"
__version__ = "2024.03.10"

import rhinoscriptsyntax as rs

if x == 0:
    a = None
else:
    a = x
# ---------- end ghpython_script ----------
ghpython_script_2 = GhPythonScript(x=list_length_4)  # -> out, a; same code as ghpython_script
ghpython_script_3 = GhPythonScript(x=list_length_5)  # -> out, a; same code as ghpython_script
ghpython_script_4 = GhPythonScript(x=list_length_3)  # -> out, a; same code as ghpython_script
vertex_length_wood_csv = Panel(ghpython_script_2.a)
vertex_length_brick_csv = Panel(ghpython_script_4.a)
vertex_length_conc_csv = Panel(ghpython_script.a)
vertex_length_alum_csv = Panel(ghpython_script_3.a)

# ----
# distance_brick.csv
graft_tree_18 = GraftTree(Tree=point, IncludeEmptyLists=True, IncludeNullItems=True)
distance = Distance(PointA=graft_tree_18, PointB=flatten_tree_3)
flatten_tree_6 = FlattenTree(Tree=distance, Path="{0}")
multiplication_2 = Multiplication(A=mass_addition.Result)
list_length_6 = ListLength(List=flatten_tree_6)
check_distance_count = Panel(multiplication_2)
check_distance_count_2 = Panel(list_length_6)

# ----
# distance_wood.csv
graft_tree_19 = GraftTree(Tree=point, IncludeEmptyLists=True, IncludeNullItems=True)
distance_2 = Distance(PointA=graft_tree_19, PointB=flatten_tree_4)
flatten_tree_7 = FlattenTree(Tree=distance_2, Path="{0}")
multiplication_3 = Multiplication(A=mass_addition.Result, B=list_length_4)
list_length_7 = ListLength(List=flatten_tree_7)
check_distance_count_3 = Panel(multiplication_3)
check_distance_count_4 = Panel(list_length_7)

# ----
# distance.csv
# distance_conc.csv
graft_tree_20 = GraftTree(Tree=point, IncludeEmptyLists=True, IncludeNullItems=True)
distance_3 = Distance(PointA=graft_tree_20, PointB=flatten_tree_2)
flatten_tree_8 = FlattenTree(Tree=distance_3, Path="{0}")
list_length_8 = ListLength(List=flatten_tree_8)
multiplication_4 = Multiplication(A=mass_addition.Result, B=list_length_2)
check_distance_count_5 = Panel(multiplication_4)
check_distance_count_6 = Panel(list_length_8)

# ----
# distance_alum.csv
graft_tree_21 = GraftTree(Tree=point, IncludeEmptyLists=True, IncludeNullItems=True)
distance_4 = Distance(PointA=graft_tree_21, PointB=flatten_tree_5)
flatten_tree_9 = FlattenTree(Tree=distance_4, Path="{0}")
multiplication_5 = Multiplication(A=mass_addition.Result)
list_length_9 = ListLength(List=flatten_tree_9)
check_distance_count_7 = Panel(multiplication_5)
check_distance_count_8 = Panel(list_length_9)

distance_wood_csv = Panel(distance_2)
distance_brick_csv = Panel(distance)
distance_conc_csv = Panel(distance_3)
distance_alum_csv = Panel(distance_4)

# ----
# normals and angle
face_normals = FaceNormals(Mesh=mesh_join_5)  # -> Centers, Normals
ghpython_script_5 = GhPythonScript(x=face_normals.Normals)  # -> out, a, b; inputs x: list of Vector3d
# ---------- ghpython_script_5: Python ----------
__author__ = "colin"
__version__ = "2024.04.04"

import rhinoscriptsyntax as rs
import Rhino.Geometry as rg
import math

def GetClockwiseAngleInRadians(vector):
    """Calculate clockwise angle from the positive Y-axis in radians."""
    angle = math.atan2(vector.X, vector.Y)
    # Normalize the angle to be between 0 and 2*PI
    angle = angle if angle >= 0 else (2 * math.pi + angle)
    return angle

def GetClockwiseAngleInDegrees(vector):
    """Calculate clockwise angle from the positive Y-axis in degrees."""
    angle_in_radians = GetClockwiseAngleInRadians(vector)
    angle_in_degrees = angle_in_radians * (180 / math.pi)
    return angle_in_degrees

def main(normals):
    """Process list of normals to find their clockwise angles in radians and degrees."""
    angles_in_radians = [GetClockwiseAngleInRadians(normal) for normal in normals]
    angles_in_degrees = [GetClockwiseAngleInDegrees(normal) for normal in normals]
    return angles_in_radians, angles_in_degrees

# Assuming 'x' is the input variable in GH Python component that takes a list of Vector3d
# 'x' is connected to a 'Vector' parameter in GH that has your normals

# Call the main function with the list of normal vectors
angles_in_radians, angles_in_degrees = main(x)

# Assuming 'a' and 'b' are output variables in GH Python component
a = angles_in_radians  # Angles in radians
b = angles_in_degrees  # Angles in degrees
# ---------- end ghpython_script_5 ----------
normal_csv = Panel(face_normals.Normals)
angle_degree_csv = Panel(ghpython_script_5.b)

# ----
# Surrounding Building Glass
# Glass
# Target Building Glass
brep_10 = Brep(stream_gate_2.Target2)
geometry_5 = Geometry(stream_gate.Target2)
mesh_brep_5 = MeshBrep(
    Brep=brep_10,
    Settings={GridMaxCount=0, GridMinCount=16, JaggedSeams=False, MaxEdgeLength=0, MinEdgeLength=0.0001, MinTolerance=0, Refine=True, RefineAngle=0, RelativeTolerance=0.65, SimplePlanes=True, Tolerance=0})
mesh_join_6 = MeshJoin(Meshes=mesh_brep_5)

merge_14 = Merge(Data1=mesh_join_6, Data2=geometry_5)

shade_5 = HBShade(geo=merge_14, rad_mod=glassmod3)  # -> report, shades; plug-in component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

# ----
# HB Shade
merge_15 = Merge(Data1=shade.shades, Data2=shade_2.shades, Data3=shade_5.shades)
clean_tree = CleanTree(RemoveNulls=True, RemoveInvalid=True, RemoveEmpty=True, Tree=merge_15)

# ----
# HB Model
model = HBModel(shades=flatten(clean_tree))  # -> report, model; plug-in component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
assigngridsviews = HBAssignGridsAndViews(model=model.model, grids=flatten(sensorgrid))  # -> model; plug-in component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

# ----
# Simulation Engine
annualirradiance = HBAnnualIrradiance(model=assigngridsviews, wea=wea, run=Toggle(False))  # -> out, results, res_direct, avg_irr, peak_irr, radiation; plug-in component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

data = Data(annualirradiance.radiation)

# ----
# Glass
merge_16 = Merge(Data1=geometry_5, Data2=brep_10)

# ----
# Visualisation - Heatmap
panel_16 = Panel("100")
series_2 = Series(Start=0, Step=1, Count=panel_16)
min_max_2 = MinMax()  # -> Minimum, Maximum
gradient_3 = Gradient(
    LowerLimit=0,
    UpperLimit=100,
    Parameter=series_2,
    stops=[0: RGB(0, 0, 255), 0.25: RGB(50, 205, 50), 0.5: RGB(255, 225, 0), 0.75: RGB(255, 128, 0), 1: RGB(255, 0, 0)])
legendpar_2 = LBLegendParameters(min="0", max=min_max_2.Maximum, seg_count=Slider(10, range=0..10), colors=gradient_3)  # -> leg_par; plug-in component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
heatmap_2 = LBSpatialHeatmap(
    values=flatten(annualirradiance.radiation),
    mesh=mesh_join_5,
    legend_par=legendpar_2,
    legend_title="kWh/year",
    global_title="Radiation ")  # -> mesh, legend, title, colors, legend_par, vis_set; plug-in component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

# ----
# Visualisation - Wireframe
vizwiref = HBVisualizeWireframe(hb_objs=flatten(assigngridsviews))  # -> geo; plug-in component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
custom_preview = CustomPreview(Geometry=vizwiref, Material=ColourSwatch(SwatchColor=RGB(0, 0, 0)))

# ----
# Export
# label.csv
# - hb solar radiation (kwh)
data_2 = Data(data)

# ----
# building_glass_vertex.csv
deconstruct_brep_7 = DeconstructBrep(Brep=merge_16)  # -> Faces, Edges, Vertices
deconstruct_6 = Deconstruct(Point=deconstruct_brep_7.Vertices)  # -> XComponent, YComponent, ZComponent
x_coordinate_5 = Panel(deconstruct_6.XComponent)
z_coordinate_5 = Panel(deconstruct_6.ZComponent)
y_coordinate_5 = Panel(deconstruct_6.YComponent)
graft_tree_22 = GraftTree(Tree=z_coordinate_5, IncludeEmptyLists=True, IncludeNullItems=True)
graft_tree_23 = GraftTree(Tree=deconstruct_6.XComponent, IncludeEmptyLists=True, IncludeNullItems=True)
graft_tree_24 = GraftTree(Tree=deconstruct_6.YComponent, IncludeEmptyLists=True, IncludeNullItems=True)
merge_17 = Merge(Data1=graft_tree_23, Data2=graft_tree_24, Data3=graft_tree_22)
delimiter_6 = Panel(", ")
text_join_6 = TextJoin(Text=merge_17, Join=delimiter_6)  # -> flatten(Result)

label_csv = Panel(data_2)

building_glass_vertex_csv = Panel(text_join_6)

# ----
# vertex_length_glass.csv
point_8 = Point(deconstruct_brep_7.Vertices)
flatten_tree_10 = FlattenTree(Tree=point_8, Path="{0}")
list_length_10 = ListLength(List=flatten_tree_10)

ghpython_script_6 = GhPythonScript(x=list_length_10)  # -> out, a; same code as ghpython_script
vertex_length_glass_csv = Panel(ghpython_script_6.a)

# ----
# distance_glass.csv
graft_tree_25 = GraftTree(Tree=point, IncludeEmptyLists=True, IncludeNullItems=True)
distance_5 = Distance(PointA=graft_tree_25, PointB=flatten_tree_10)
flatten_tree_11 = FlattenTree(Tree=distance_5, Path="{0}")
multiplication_6 = Multiplication(A=mass_addition.Result)
list_length_11 = ListLength(List=flatten_tree_11)
check_distance_count_9 = Panel(multiplication_6)
check_distance_count_10 = Panel(list_length_11)

distance_glass_csv = Panel(distance_5)

# ==== cluster Cluster

# ---- group: Cluster Input
material_list = ClusterInput()

# ----
list_item = ListItem(List=material_list, Index="0", Wrap=True)
list_item_2 = ListItem(List=material_list, Index="1", Wrap=True)
list_item_3 = ListItem(List=material_list, Index="2", Wrap=True)
list_item_4 = ListItem(List=material_list, Index="3", Wrap=True)
list_item_5 = ListItem(List=material_list, Index="4", Wrap=True)
list_item_6 = ListItem(List=material_list, Index="5", Wrap=True)

# ---- group: Cluster Output
material_name = ClusterOutput(list_item)

r_ref = ClusterOutput(list_item_2)

rough = ClusterOutput(list_item_6)

g_ref = ClusterOutput(list_item_3)

b_ref = ClusterOutput(list_item_4)

spec = ClusterOutput(list_item_5)
